# Grasshopper definition robotic_brick_laying.ghx (Grasshopper 1.0.7)

bricks = GhPythonScript()  # -> out, surfaces, planes, robot_crv
# ---------- bricks: Python ----------
from compas_rhino import unload_modules
unload_modules('model')

from model import Wall
from model import Fabrication
import Rhino.Geometry as rg



myWall = Wall(5,10)
surfaces = myWall.geometric_model()
script, visualisation = myWall.fabrication_model()

planes, robot_crv = visualisation


print (script)
# ---------- end bricks ----------
geo = Geometry(bricks.surfaces)
geo_2 = Geometry(bricks.planes)
geo_3 = Geometry(bricks.robot_crv)
item = ListItem(List=bricks.surfaces, Index=Slider(94, range=0..100), Wrap=True)
geo_4 = Geometry(item)
